# Grasshopper definition base_geometry.gh (Grasshopper 1.0.8)

# ----
# Connector Offset
number_slider = Slider(0.15, range=0..1)

# ----
# Magnet settings
number_slider_2 = Slider(10, range=0..10)

# ----
# Parameters most likely to need adjustments are marked in yellow.
# 
# Tile Size: (default 200 mm)
# 
# Height: (default 20mm)
# 
# Connector Offset: Controls connector offset relative to connector housing. Might need adjustment depending on what printer is used. Test print is recommended. 0.15 mm was optimal when using a Prusa MK4S with 0.4mm nozzle.
# 
# Magnet Settings: diameter (10mm), thickness (2mm), and offset from perimeter (8mm).
# 
# Other parameters are likely fine for most applications. Change if needed.
# Tile Size
number_slider_3 = Slider(200, range=0..1000)

# ----
# Height
number_slider_4 = Slider(20, range=0..100)

number_slider_5 = Slider(8, range=0..10)
number_slider_6 = Slider(10, range=0..10)
cluster = Cluster(
    tile_size=number_slider_3,
    wall_thickness=number_slider_5,
    height=number_slider_4,
    connector_housing_width=Slider(30, range=0..100),
    slot_thickness=Slider(4, range=0..10),
    connector_width=number_slider_6,
    brim_allowance=Slider(0.1, range=0..1),
    connector_offset=number_slider,
    connector_fillet_radius=Slider(0.5, range=0..1),
    magnet_diameter=number_slider_2,
    magnet_thickness=Slider(2, range=0..10),
    magnet_perimeter_offset=Slider(8, range=0..10),
    cross_thickness=Slider(3, range=0..10),
    center_circle_diameter=Slider(20, range=0..100))  # -> end_cap_2, connector_2, tile_2
brep = Brep(cluster.connector_2)
brep_2 = Brep(cluster.end_cap_2)
brep_3 = Brep(cluster.tile_2)

# ----
# Connector Arrays
# Connectors
# End Caps
array_margin = Slider(3, range=0..10)
expression = Expression(x=number_slider_5, y=array_margin, Expression="x*2+y")
expression_2 = Expression(x=number_slider_6, y=array_margin, Expression="x+y")
expression_3 = Expression(x=number_slider_5, y=array_margin, Expression="x+y")
expression_4 = Expression(x=number_slider_6, y=array_margin, Expression="x+y")
rectangle = Rectangle(Plane=PlaneXY(0, 0, 0), XSize=expression_2, YSize=expression_3, Radius=0)  # -> Rectangle, Length
rectangle_2 = Rectangle(Plane=PlaneXY(0, 0, 0), XSize=expression_4, YSize=expression, Radius=0)  # -> Rectangle, Length
arrrec = RectangularArray(Geometry=brep_2, Cell=rectangle.Rectangle, XCount=Slider(6, range=0..10), YCount=Slider(4, range=0..10))  # -> Geometry, Transform
arrrec_2 = RectangularArray(Geometry=brep, Cell=rectangle_2.Rectangle, XCount=Slider(6, range=0..10), YCount=Slider(4, range=0..10))  # -> Geometry, Transform
connectors = Brep(arrrec_2.Geometry)
end_caps = Brep(arrrec.Geometry)

# ----
# Tile Array
number_slider_7 = Slider(3, range=0..10)
rectangle_3 = Rectangle(Plane=PlaneXY(0, 0, 0), XSize=number_slider_3, YSize=number_slider_3, Radius=0)  # -> Rectangle, Length
arrrec_3 = RectangularArray(Geometry=brep_3, Cell=rectangle_3.Rectangle, XCount=number_slider_7, YCount=Slider(5, range=0..10))  # -> Geometry, Transform

# ==== cluster Cluster
cross_thickness = ClusterInput()
center_circle_diameter = ClusterInput()
magnet_thickness = ClusterInput()
magnet_diameter = ClusterInput()
magnet_perimeter_offset = ClusterInput()

# ----
# Connectors
connector_offset = ClusterInput()
connector_fillet_radius = ClusterInput()
brim_allowance = ClusterInput()
connector_width = ClusterInput()
connector_width_2 = Number(connector_width)
brim_allowance_2 = Number(brim_allowance)
connector_offset_2 = Number(connector_offset)
connector_fillet_radius_2 = Number(connector_fillet_radius)
pt = ConstructPoint(XCoordinate=0, YCoordinate=0, ZCoordinate=0)
expression = Expression(x=connector_width_2, y=connector_offset_2, Expression="x-2*y")
dom = ConstructDomain(DomainStart=expr("-x/2", connector_width_2), DomainEnd=expr("x/2", connector_width_2))
dom_2 = ConstructDomain(DomainStart=expr("-x/2+1", connector_width_2), DomainEnd=expr("x/2-1", connector_width_2))
xy = XYPlane(Origin=pt)
dom_3 = ConstructDomain(DomainStart=expr("-x/2+1", expression), DomainEnd=expr("x/2-1", expression))
dom_4 = ConstructDomain(DomainStart=expr("-x/2", expression), DomainEnd=expr("x/2", expression))
connector_thickness = Slider(3, range=0..10)
neg = Negative(Value=brim_allowance_2)
Z = UnitZ(Factor=neg)
Z_2 = UnitZ(Factor=1)
xz = XZPlane(Origin=Point(0, 0, 0))

# ----
# Walls
tile_size = ClusterInput()
wall_thickness = ClusterInput()
height = ClusterInput()
connector_housing_width = ClusterInput()
slot_thickness = ClusterInput()
tile_size_2 = Number(tile_size)
wall_thickness_2 = Number(wall_thickness)
connector_housing_width_2 = Number(connector_housing_width)
slot_thickness_2 = Number(slot_thickness)
height_2 = Number(height)
height_vector = UnitZ(Factor=height_2)
neg_2 = Negative(Value=wall_thickness_2)
outer_wall_edge = Rectangle(Plane=PlaneXY(0, 0, 0), XSize=tile_size_2, YSize=tile_size_2, Radius=0)  # -> Rectangle, Length
inner_wall_edge = OffsetCurve(Curve=outer_wall_edge.Rectangle, Distance=neg_2, Corners=1)
merge = Merge(Data1=outer_wall_edge.Rectangle, Data2=inner_wall_edge)  # -> flatten(Result)
wall_centerline = OffsetCurve(Curve=outer_wall_edge.Rectangle, Distance=expr("x/2", neg_2), Corners=1)
boundary = BoundarySurfaces(Edges=merge)
explode = Explode(Curve=wall_centerline, Recursive=True)  # -> graft(Segments), Vertices
Z_3 = UnitZ(Factor=1)
midpt = CurveMiddle(Curve=explode.Segments)
xprod = CrossProduct(VectorA=explode.Segments, VectorB=Z_3, Unitize=False)  # -> Vector, Length
dom_5 = ConstructDomain(DomainStart=expr("-x/2", slot_thickness_2), DomainEnd=expr("x/2", slot_thickness_2))
pl = ConstructPlane(Origin=midpt, XAxis=xprod.Vector, YAxis=explode.Segments)
add = Extrude(Base=boundary, Direction=height_vector)

# ----
# Center Hole
center_circle_diameter_2 = Number(center_circle_diameter)
area = Area(Geometry=outer_wall_edge.Rectangle)
circle = CircleCNR(Center=area, Normal=Vector(0, 0, 1), Radius=expr("x/2", center_circle_diameter_2))
boundary_2 = BoundarySurfaces(Edges=circle)
offset = OffsetCurve(Curve=circle, Distance=-3, Corners=1)
boundary_3 = BoundarySurfaces(Edges=offset)
add_2 = Extrude(Base=boundary_2, Direction=height_vector)
subtract = Extrude(Base=boundary_3, Direction=height_vector)

# ----
# Magnet Holes
magnet_perimeter_offset_2 = Number(magnet_perimeter_offset)
neg_3 = Negative(Value=magnet_perimeter_offset_2)
magnet_thickness_2 = Number(magnet_thickness)
magnet_diameter_2 = Number(magnet_diameter)
offset_2 = OffsetCurve(Curve=outer_wall_edge.Rectangle, Distance=neg_3, Corners=1)
disc = Discontinuity(Curve=offset_2, Level=1)  # -> Points, Parameters
cir = Circle(Plane=disc.Points, Radius=expr("x/2", magnet_diameter_2))
offset_3 = OffsetCurve(Curve=cir, Distance=-0.5, Corners=1)
extr = Extrude(Base=offset_3, Direction=height_vector)
cir_2 = Circle(Plane=disc.Points, Radius=expr("x-0.2", magnet_perimeter_offset_2))
extr_2 = Extrude(Base=cir_2, Direction=height_vector)
add_3 = CapHoles(Brep=extr_2)

# ----
# Cross
cross_thickness_2 = Number(cross_thickness)
item = ListItem(List=disc.Points, Index=0, Wrap=True)  # -> Item, Item1, Item2, Item3
ln = Line(StartPoint=item.Item1, EndPoint=item.Item3)
ln_2 = Line(StartPoint=item.Item, EndPoint=item.Item2)
series = Series(Start=expr("-x/2", cross_thickness_2), Step=cross_thickness_2, Count=2)
offset_4 = OffsetCurve(Curve=[ln_2, ln], Distance=graft(series), Corners=1)  # -> flatten(Curve)
item_2 = ListItem(List=offset_4, Index=0, Wrap=True)  # -> Item, Item1, Item2, Item3
loft = Loft(
    Curves=[item_2.Item, item_2.Item2],
    Options={Adjust=False, Closed=False, LoftEnds=0, LoftSimp=0, LoftType=0, Rebuild=10, Refit=0.01})
loft_2 = Loft(
    Curves=[item_2.Item1, item_2.Item3],
    Options={Adjust=False, Closed=False, LoftEnds=0, LoftSimp=0, LoftType=0, Rebuild=10, Refit=0.01})
extr_3 = Extrude(Base=[loft, loft_2], Direction=height_vector)
add_4 = SolidUnion(Breps=extr_3)

expression_2 = Expression(x=wall_thickness_2, Expression="x/2")
Y = UnitY(Factor=expression_2)
expression_3 = Expression(x=height_2, Expression="x-5")
rectangle = Rectangle(Plane=xy, XSize=dom, YSize=expression_2, Radius=0)  # -> Rectangle, Length
move = Move(Geometry=xy, Motion=Y)  # -> Geometry, Transform
expression_4 = Expression(x=wall_thickness_2, Expression="x/4")
expression_5 = Expression(x=expression_2, y=connector_offset_2, Expression="x+y")
merge_2 = Merge(Data1=connector_thickness, Data2=expression_3)  # -> simplify(graft(Result))
rectangle_2 = Rectangle(Plane=move.Geometry, XSize=dom, YSize=expression_4, Radius=0)  # -> simplify(flatten(Rectangle)), Length
offset_5 = OffsetCurve(Curve=rectangle_2.Rectangle, Distance=expr("-x", connector_offset_2), Corners=1)  # -> simplify(flatten(Curve))
rectangle_3 = Rectangle(Plane=xy, XSize=dom_4, YSize=expression_5, Radius=0)  # -> simplify(flatten(Rectangle)), Length
rectangle_4 = Rectangle(Plane=move.Geometry, XSize=dom_2, YSize=expression_2, Radius=0)  # -> simplify(flatten(Rectangle)), Length
expression_6 = Expression(x=expression_4, y=connector_offset_2, Expression="x/2+x")
area_2 = Area(Geometry=offset_5)  # -> Area, Centroid
merge_3 = Merge(Data1=rectangle_4.Rectangle, Data2=rectangle_2.Rectangle, Data3=rectangle.Rectangle)
rectangle_5 = Rectangle(Plane=area_2.Centroid, XSize=dom_3, YSize=expression_6, Radius=0)  # -> simplify(flatten(Rectangle)), Length
offset_6 = OffsetCurve(Curve=merge_3, Distance=brim_allowance_2, Corners=1)  # -> simplify(flatten(Curve))
expression_7 = Expression(x=merge_2, y=connector_offset_2, Expression="x-y")
path_mapper = PathMapper(rectangle_2.Rectangle, source="{0}", target="{1}")
path_mapper_2 = PathMapper(rectangle_4.Rectangle, source="{0}", target="{1}")
path_mapper_3 = PathMapper(offset_5, source="{0}", target="{1}")
path_mapper_4 = PathMapper(rectangle_5.Rectangle, source="{0}", target="{1}")
neg_4 = Negative(Value=merge_2)
neg_5 = Negative(Value=expression_7)
explode_2 = Explode(Curve=outer_wall_edge.Rectangle, Recursive=True)  # -> graft(Segments), Vertices
extr_4 = Extrude(Base=offset_6, Direction=Z)
merge_4 = Merge(Data1=path_mapper_2, Data2=path_mapper, Data3=rectangle.Rectangle)
Z_4 = UnitZ(Factor=neg_4)
expression_8 = Expression(s=tile_size_2, m=magnet_perimeter_offset_2, w=connector_housing_width, Expression="s/2-m*2-w/2")
Z_5 = UnitZ(Factor=neg_5)
midpt_2 = CurveMiddle(Curve=explode_2.Segments)
merge_5 = Merge(Data1=rectangle_3.Rectangle, Data2=path_mapper_3, Data3=path_mapper_4)
unit = UnitVector(Vector=explode_2.Segments)
extr_5 = Extrude(Base=merge_4, Direction=Z_4)
series_2 = Series(Start=expr("-x", expression_8), Step=expr("2*x", expression_8), Count=2)
extr_6 = Extrude(Base=merge_5, Direction=Z_5)
merge_6 = Merge(Data1=extr_5, Data2=extr_4)  # -> flatten(Result)
cap = CapHoles(Brep=extr_6)  # -> flatten(Brep)
multiplication = Multiplication(A=series_2, B=unit)
cap_2 = CapHoles(Brep=merge_6)
addition = Addition(A=height_vector, B=multiplication)
xprod_2 = CrossProduct(VectorA=Z_2, VectorB=unit, Unitize=False)  # -> Vector, Length
sunion = SolidUnion(Breps=cap)
sunion_2 = SolidUnion(Breps=cap_2)
fmerge = MergeFaces(Brep=sunion)  # -> Breps, Before, After
move_2 = Move(Geometry=midpt_2, Motion=addition)  # -> Geometry, Transform
edges = BrepEdges(Brep=fmerge.Breps)  # -> Naked, Interior, NonManifold
pl_2 = ConstructPlane(Origin=move_2.Geometry, XAxis=explode_2.Segments, YAxis=xprod_2.Vector)
midpt_3 = CurveMiddle(Curve=edges.Interior)
pdecon = Deconstruct(Point=midpt_3)  # -> XComponent, YComponent, ZComponent
orient = Orient(Geometry=sunion_2, Source=xy, Target=pl_2)  # -> Geometry, Transform
bnd = Bounds(Numbers=pdecon.ZComponent)
dedomain = DeconstructDomain(Domain=bnd)  # -> Start, End
subtract_2 = Brep(orient.Geometry)
equals = Equality(FirstNumber=dedomain.Start, SecondNumber=pdecon.ZComponent)  # -> Equality, Inequality
cull = CullPattern(List=edges.Interior, CullPattern=equals.Equality)
index = ItemIndex(List=edges.Interior, Item=cull)
filedge = FilletEdge(Shape=fmerge.Breps, Blend=0, Metric=0, Edges=index, Radii=connector_fillet_radius_2)
rotate = Rotate(Geometry=filedge, Angle="Pi", Plane=xz)  # -> Geometry, Transform
mirror = Mirror(Geometry=rotate.Geometry, Plane=xz)  # -> Geometry, Transform
merge_7 = Merge(Data1=rotate.Geometry, Data2=mirror.Geometry)  # -> flatten(Result)
sunion_3 = SolidUnion(Breps=merge_7)
end_cap = Brep(rotate.Geometry)
connector = Brep(sunion_3)
end_cap_2 = ClusterOutput(end_cap)
connector_2 = ClusterOutput(connector)

addition_2 = Addition(A=magnet_thickness_2, B=0.5)

Z_6 = UnitZ(Factor=addition_2)
extr_7 = Extrude(Base=cir, Direction=Z_6)  # -> graft(Extrusion)
subtraction = Subtraction(A=height_vector, B=Z_6)
move_3 = Move(Geometry=extr_7, Motion=subtraction)  # -> Geometry, Transform
merge_8 = Merge(Data1=extr_7, Data2=move_3.Geometry, Data3=extr)
cap_holes = CapHoles(Brep=merge_8)
subtract_3 = SolidUnion(Breps=cap_holes)

expression_9 = Expression(s=tile_size_2, m=magnet_perimeter_offset_2, w=connector_housing_width, Expression="s/2-m*2-w")
dom_6 = ConstructDomain(DomainStart=expr("-x", expression_9), DomainEnd=expr("x", expression_9))
rectangle_6 = Rectangle(Plane=pl, XSize=dom_5, YSize=dom_6, Radius=0)  # -> Rectangle, Length
fillet = Fillet(Curve=rectangle_6.Rectangle, Radius=expr("x/3", slot_thickness_2))
extr_8 = Extrude(Base=fillet, Direction=height_vector)
subtract_4 = CapHoles(Brep=extr_8)

subtract_5 = Merge(Data1=subtract_3, Data2=subtract, Data3=subtract_4, Data4=subtract_2)
add_5 = Merge(Data1=add, Data2=add_3, Data3=add_4, Data4=add_2)
sunion_4 = SolidUnion(Breps=flatten(add_5))
sdiff = SolidDifference(BrepsA=flatten(sunion_4), BrepsB=flatten(subtract_5))
fmerge_2 = MergeFaces(Brep=sdiff)  # -> Breps, Before, After
tile = Brep(fmerge_2.Breps)
tile_2 = ClusterOutput(tile)
